# Grasshopper definition slicer.gh (Grasshopper 1.0.7)

number_slider = Slider(32, range=0..100)
srf = Surface(<surface referenced from the Rhino model>)
Z = UnitZ(Factor=Slider(1.5, range=0..10))
Z_2 = UnitZ(Factor=Slider(3, range=0..10))
trigger = Trigger(Interval=50, TimerInterval=50, Target=python)  # disabled
sdivide = DivideSurface(Surface=srf, UCount=number_slider, VCount=Slider(39, range=0..100))  # -> Points, Normals, Parameters
addition = Addition(A="1", B=number_slider)
move = Move(Geometry=sdivide.Points, Motion=Z)  # -> Geometry, Transform
move_2 = Move(Geometry=sdivide.Points, Motion=Z_2)  # -> Geometry, Transform
python = GhPythonScript(state=Toggle(False), x=addition)  # -> out, a, b; inputs state: Boolean
# ---------- python: Python ----------
from scriptcontext import sticky
move = 1
if not state:
    sticky["valX"] = 0
    sticky["valY"] = 0
else:
    sticky["valX"] += move
#    if sticky["valX"] == 0:
#        move = move
#        if sticky["valY"] != 0:
#            sticky["valY"] += 1
#    elif sticky["valX"] == x:
#        move = -move
#        sticky["valX"] += move
#        sticky["valY"] += 1

a = sticky["valX"]

if a % 40 == 0 and a != 0:
    sticky["valY"] += 1
    
b = sticky["valY"]
# ---------- end python ----------
flip = FlipMatrix(Data=move.Geometry)
pln = Plane(sdivide.Points)
python_2 = GhPythonScript(x=sdivide.Points)  # -> out, a; inputs x: tree of Point3d
# ---------- python_2: Python ----------
import ghpythonlib.treehelpers as th
 
x = th.tree_to_list(x)
a = []

i = 0

for col in x:
#    col.reverse()
    for row in col:
#        row.reverse()
        if i % 2 == 0:
            row.reverse()
        i+=1
        for item in row:
            a.append(item)
# ---------- end python_2 ----------
intcrv = Interpolate(Degree=3, Periodic=False, KnotStyle=1)  # -> Curve, Length, Domain
python_3 = GhPythonScript(x=move_2.Geometry)  # -> out, a; inputs x: tree of Point3d
# ---------- python_3: Python ----------
import ghpythonlib.treehelpers as th
 
x = th.tree_to_list(x)
a = []

i = 0

for col in x:
    for row in col:
        if i % 2 == 0:
            row.reverse()
        i+=1
        for item in row:
            a.append(item)
# ---------- end python_3 ----------
python_4 = GhPythonScript(x=flip)  # -> out, a; inputs x: tree of Point3d
# ---------- python_4: Python ----------
import ghpythonlib.treehelpers as th
 
x = th.tree_to_list(x)
a = []

i = 0

for col in x:
    
    for row in col:
        row.reverse()
        if i % 2 == 0:
            row.reverse()
        i+=1
        for item in row:
            a.append(item)
# ---------- end python_4 ----------
panel = Panel(python.a)
panel_2 = Panel(python.b)
item = ListItem(List=pln, Index=python.a, Wrap=True)
panel_3 = Panel(python_3.a)
panel_4 = Panel(python_2.a)
panel_5 = Panel(python_4.a)
item_2 = ListItem(List=flatten(item), Index=python.b, Wrap=True)
number_slider_2 = Slider(20, range=0..100)
cyl = Cylinder(Base=item_2, Radius=Slider(25, range=0..50), Length=Slider(40, range=0..50))
Z_3 = UnitZ(Factor=number_slider_2)
cyl_2 = Cylinder(Base=item_2, Radius=Slider(2, range=0..10), Length=number_slider_2)
brep = Brep(<brep referenced from the Rhino model>)
python_5 = GhPythonScript(x=panel_4, y=panel_5, z=panel_3)  # -> a, b, c; inputs x: Point3d, y: Point3d, z: Point3d
# ---------- python_5: Python ----------
#if x.X == 0.0 or y.X == 0 or z.X == 0:
#    x.X = -0.0
#    y.X = -0.0
#    z.X = -0.0

a = 'G1 F1200 X' + str(x.X) + ' Y' + str(x.Y) + ' Z' + str(x.Z)
b = 'G1 F1200 X' + str(y.X) + ' Y' + str(y.Y) + ' Z' + str(y.Z)
c = 'G1 F1200 X' + str(z.X) + ' Y' + str(z.Y) + ' Z' + str(z.Z)
# ---------- end python_5 ----------
move_3 = Move(Geometry=cyl, Motion=Z_3)  # -> Geometry, Transform
cap = CapHoles(Brep=cyl_2)
panel_6 = Panel(python_5.c)
panel_7 = Panel(python_5.a)
panel_8 = Panel(python_5.b)
cap_2 = CapHoles(Brep=move_3.Geometry)
swatch = ColourSwatch(SwatchColor=RGB(206, 245, 88))
bbx = BrepBrep(BrepA=cap_2, BrepB=brep)  # -> Curves, Points
rec = DataRecorder(bbx.Curves, DataLimit=-10, RecordData=False)
preview = CustomPreview(Geometry=cap_2, Material=swatch)
preview_2 = CustomPreview(Geometry=cap, Material=swatch)
panel_9 = Panel(rec)
panel_10 = Panel([panel_7, panel_8, panel_6])
