# Grasshopper definition surface.gh (Grasshopper 1.0.7)

number_slider = Slider(100, range=0..100)
rectangle = Rectangle(Plane=PlaneXY(0, 0, 0), XSize=number_slider, YSize=number_slider, Radius=0)  # -> Rectangle, Length
number_slider_2 = Slider(10, range=0..100)
sdivide = DivideSurface(Surface=rectangle.Rectangle, UCount=number_slider_2, VCount=number_slider_2)  # -> flatten(Points), flatten(Normals), Parameters
dom = ConstructDomain(DomainStart=Slider(26, range=0..100), DomainEnd=Slider(50, range=0..100))
lng = ListLength(List=sdivide.Points)
random = Random(Range=dom, Number=lng, Seed=Slider(3, range=0..10))
amp = Amplitude(Vector=sdivide.Normals, Amplitude=random)
move = Move(Geometry=sdivide.Points, Motion=amp)  # -> Geometry, Transform
addition = Addition(A=number_slider_2, B="1")
srfgrid = SurfaceFromPoints(Points=move.Geometry, UCount=addition, Interpolate=False)
